# Grasshopper definition 9_ML_Inference.ghx (Grasshopper 1.0.8)
# plug-ins: Eddy3D

# ---- group: model selection
list = ValueList({"GAN": 0, "FNO": 1}, selected="FNO")

# ----
select = SelectTemplate()

# ---- group: GAN- ONNX File
path = FilePath("C:\Users\ilker\Desktop\Conditional_Transformer\Pix2PixHD_Model\pix2pixhd_model.onnx")

# ---- group: FNO_ONXX file
path_2 = FilePath("C:\Users\ilker\Desktop\FNO\hybrid_fno.onnx")

# ----
entwine = Entwine(Branch00=path, Branch01=path_2, FlattenInputs=True)  # -> simplify(Result)
branch = TreeBranch(Tree=entwine, Path=list, MaintainPaths=False)

# ---- group: TERRAIN
srf = Surface(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)

# ---- group: wind direction
list_2 = ValueList({"North": 0, "Northeast": 45, "East": 90, "Southeast": 135, "South": 180, "Southwest": 225, "West": 270, "Northwest": 315}, selected="North")

# ----
move = Move(Geometry=srf, Motion=Vector(0, 0, 1.8))  # -> Geometry, Transform
brep2grid = BrepToGridPoints(Geometry=move.Geometry, Spacing="2", Run=True)  # -> Points, Status

# ---- group: Buildings
brep = Brep([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])

# ---- group: Legend Settings
list_3 = ValueList({"Jet": "jet", "Turbo": "turbo", "Viridis": "viridis", "Magma": "magma", "Plasma": "plasma", "Inferno": "inferno", "Coolwarm": "coolwarm", "Pastel": "pastel", "Gray": "gray"}, selected="Turbo")
dom = ConstructDomain(DomainStart=0, DomainEnd="5")

# ----
preview = CustomPreview(Geometry=brep, Material=ColourSwatch(SwatchColor=RGB(204, 204, 204)))
windpredict = WindPredictor(
    Points=brep2grid.Points,
    Buildings=brep,
    ONNXPath=branch,
    U_ref="5",
    Z_ref=10,
    Pedestrian_level=1.8,
    Wind_dir=list_2,
    GPU=True,
    FilterMargin=100,
    Palette=list_3,
    LegendDomain=dom,
    Interpolate=False)  # -> X, Y, WindSpeed, GridMesh, LegendMesh, LegendPoints, LegendValues
bnd = Bounds(Numbers=windpredict.WindSpeed)
mesh = Mesh(windpredict.GridMesh)
mesh_2 = Mesh(windpredict.LegendMesh)
tag = TextTag(Location=windpredict.LegendPoints, Text=windpredict.LegendValues, Colour=RGB(0, 0, 0))

# ---- group: Wind speed range
panel = Panel(bnd)
