# Grasshopper definition CylinderDomain.ghx (Grasshopper 1.0.8)
# plug-ins: Outdoor, Eddy3D

select_template = SelectTemplate()
wind_directions = Panel("""0
45
90
135
180
225
270
315""")
cyldomain = CylinderDomain(
    CoreCellSize="25",
    InnerCoreSize=-1,
    OuterRadius=-1,
    Height=-1,
    RadialMultiplier=2,
    CoreDivisions=1,
    RefinementBoxExtension=-1,
    RadialGrading=7,
    CoreRoundness=0.65,
    VerticalGrading=35)
mesh_settings = MeshSettings(
    RefinementBoxLevel=2,
    BuildingSurfaceLevel=2,
    BuildingFeatureLevel=2,
    GroundSurfaceLevel=3,
    LayerCount=4,
    AddLayers=False,
    Snap=True,
    GradingStrengthHorizontal="25",
    GradingStrengthVertical="25",
    AdaptiveGrading=True)
run_settings = RunSettings(
    Iterations=1000,
    WriteInterval=20,
    KeepTimeSteps=3,
    TurbulenceModel="realizableKE",
    CPUCount=-1,
    SolverAlgorithm="SIMPLE",
    AgeOfAir=False,
    Robustness="4",
    PotentialFoamInit=True,
    WarmUpIterations=-1,
    FieldMonitors=False,
    PedestrianAverage=False,
    Convergence_2=0.0001)  # -> RunSettings, DebugLogs
atmospheric_boundary_layer = AtmosphericBoundaryLayer(
    WindDirections=wind_directions,
    ReferenceHeight=10,
    RoughnessLengthZ0=1,
    GroundHeight=0,
    TurbulentKEK=0.015,
    TurbulentEpsilonΕ=0.135,
    TurbulentOmegaΩ=100)  # -> BoundaryConditions, WindVectors
geometry = Geometry([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])
geometry_2 = Geometry(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)
tree = Tree(Geometry=geometry_2)
outdoor_case = OutdoorCase(
    BoundaryConditions=atmospheric_boundary_layer.BoundaryConditions,
    DomainParameters=cyldomain,
    Buildings=geometry,
    Trees=tree,
    MeshSettings=mesh_settings,
    RunSettings=run_settings.RunSettings,
    Write=False,
    ClearCase=False,
    AutoName="merry-lemur-dune-quill",
    PreviewDimensions=True,
    PreviewGrid3D=False,
    PreviewGroundGrid=True,
    PreviewRefinementBox=True,
    PreviewWindArrows=True)  # -> Logs, WriteLogs, Case, Domain, RefinementBox, Buildings
plot_residuals = PlotResiduals(Case=outdoor_case.Case, Plot=False, ResidualViewerTarget=0)
live_residuals = LiveResiduals(Case=outdoor_case.Case, Live=True, DirectionDegrees=-1)
meshing_progress = MeshingProgress(Case=outdoor_case.Case, Live=True)  # -> Progress, Phase, Done, Status
open_in_paraview = OpenInParaView(Case=outdoor_case.Case, Open=False, ComfortMetric=1, DirectionIndex=-1)
run = Run(
    Case=outdoor_case.Case,
    Mesh=Button(),
    CreateZones=Button(),
    Simulate=Button(),
    RunAll=False,
    Parallel=True,
    Engine="BlueCFD",
    DirectionIndex=-1,
    ShowZones=True)
geometry_3 = Geometry([Point(-80.2763443, -188.6662445, 0), Point(-80.2763443, -185.6625214, 0), Point(-80.2763443, -182.6588135, 0), Point(-80.2763443, -179.6550903, 0), Point(-80.2763443, -176.6513672, 0), Point(-80.2763443, -173.6476593, 0)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])
probe = Probe(
    Case=outdoor_case.Case,
    Points=geometry_3,
    Fields="U",
    ProbeName="probes",
    Run=False,
    BakeTimeHistory=False,
    CullHugeVectors=True,
    CullInvalid=True,
    ShowRegion=False)  # -> Values, TimeSteps, SubResults
vectors = Data(probe.Values)
cluster = Cluster(data=vectors)  # -> S, E, data_3
gradient = Gradient(
    LowerLimit=cluster.S,
    UpperLimit=cluster.E,
    Parameter=cluster.data_3,
    stops=[0.103: RGB(0, 0, 255), 0.22: RGB(0, 170, 255), 0.305: RGB(0, 255, 255), 0.398: RGB(0, 255, 188), 0.504: RGB(0, 255, 106), 0.605: RGB(91, 255, 0), 0.699: RGB(184, 255, 0), 0.799: RGB(255, 255, 0), 0.898: RGB(255, 170, 0)])
vdisex = VectorDisplayEx(Point=geometry_3, Vector=vectors, Colour=gradient, Width=Slider(3, range=0..10))

# ==== cluster Cluster
data = ClusterInput()
data_2 = Data(data)
data_3 = ClusterOutput(data_2)
bnd = Bounds(Numbers=data_2)
dedomain = DeconstructDomain(Domain=bnd)  # -> Start, End
S = ClusterOutput(dedomain.Start)
E = ClusterOutput(dedomain.End)
